# Dynamo graph Excel2Levels.dyn (Dynamo 2.18.1.5096)
# packages: ExcelReader 134.1.1

file_path = Filename("..\..\Documents\JEGA LEVELS.xlsx")
file_from_path = FileObject(path=file_path)
string = StringInput("Sheet1")
read = EPPlus.ExcelReader.ExcelFile.Read(file=file_from_path, sheetName=string)
watch = Watch(read)
number = DoubleInput(0)
getItemAtIndex = List.GetItemAtIndex(list=watch, index=number)
reverse = List.Reverse(list=getItemAtIndex)
number_2 = DoubleInput(1)
watch_2 = Watch(reverse)
string_from_object = FromObject(object=watch_2)
watch_3 = Watch(string_from_object)
count = List.Count(list=watch_3)
range = Range(start=number_2, end=count, step=number_2)
watch_4 = Watch(range)
string_from_object_2 = FromObject(object=watch_4)
watch_5 = Watch(string_from_object_2)
byElevationAndName = Level.ByElevationAndName(elevation=reverse, name=watch_5, lacing=Shortest)
watch_6 = Watch()  # unwired: arg0
